# Grasshopper definition CutnFill_LSTM_env.gh (Grasshopper 1.0.7)
# plug-ins: GH_CPython, HoopSnake, Pufferfish

# ----
# TERRAIN GENERATION
terrain_unit_size = Slider(50, range=0..1000)
tuc_02_terrain_complexity = Slider(8, range=0..100)
tuc_03 = Slider(16, range=0..100)
tuc_04 = Slider(32, range=0..100)
height_max_02 = Slider(64, range=0..500)
height_max_03 = Slider(16, range=0..500)
height_max_04 = Slider(8, range=0..500)
terrain_unit_count_tuc_01 = Slider(4, range=0..100)
height_max_01 = Slider(256, range=0..1000)
start_pt = ConstructPoint(XCoordinate=0, YCoordinate=0, ZCoordinate=0)
terrain_generator = TerrainGenerator(
    start_point=start_pt,
    length=terrain_unit_size,
    width=terrain_unit_size,
    tuc_01=expr("x+1", terrain_unit_count_tuc_01),
    tuc_02=tuc_02_terrain_complexity,
    tuc_03=tuc_03,
    tuc_03_2=tuc_04,
    hmax01=height_max_01,
    hmax02=height_max_02,
    hmax03=height_max_03,
    hmax04=height_max_04,
    seed=Slider(200, range=0..1000))  # -> base_srf, terrain_srf

# ---- group: Slope Mapping
# TERRAIN VISUALIZATION
resolution = Slider(200, range=0..1000)
mesh_uv = MeshSurface(Surface=terrain_generator.terrain_srf, UCount=resolution, VCount=resolution, Overhang=True, Equalize=True)
demesh = DeconstructMesh(Mesh=mesh_uv)  # -> Vertices, Faces, Colours, Normals
Z = UnitZ(Factor=1)
angle = Angle(VectorA=demesh.Normals, VectorB=Z)  # -> Angle, Reflex
deg = Degrees(Radians=angle.Angle)
gradient = Gradient(
    LowerLimit=0,
    UpperLimit=90,
    Parameter=deg,
    stops=[0: RGB(229, 229, 151), 0: RGB(230, 232, 209), 0.353: RGB(161, 203, 145), 0.498: RGB(105, 172, 143), 0.655: RGB(66, 139, 135), 0.801: RGB(51, 105, 117), 1: RGB(47, 72, 88)])
mcol = MeshColours(Mesh=mesh_uv, Colours=gradient)

# ----
path = DataPath("{0}")
path_2 = DataPath("{1}")
path_3 = DataPath("{2}")

# ---- group: Terrain/Base Srfs
srf = Surface(terrain_generator.terrain_srf)
srf_2 = Surface(terrain_generator.base_srf)

# ---- group: Contours
Z_2 = UnitZ(Factor=1)
contour = Contour(Shape=terrain_generator.terrain_srf, Point=Point(0, 0, 0), Direction=Z_2, Distance=Slider(6, range=0..10))
preview = CustomPreview(Geometry=contour, Material=ColourSwatch(SwatchColor=RGB(0, 0, 0)))

# ---- group: Terrain Srf Visual
bbox = BoundingBox(Content=terrain_generator.terrain_srf, Plane=PlaneXY(0, 0, 0), UnionBox=False)  # -> Box, Box_2
sint = SolidIntersection(BrepsA=bbox.Box, BrepsB=terrain_generator.terrain_srf)
Z_3 = UnitZ(Factor=-3)
move = Move(Geometry=sint, Motion=Z_3)  # -> Geometry, Transform
preview_2 = CustomPreview(Geometry=move.Geometry, Material=ColourSwatch(SwatchColor=RGB(255, 255, 235)))

# ---- group: RH_IN:length
num = Number(Slider(10, range=0..100))

# ---- group: RH_IN:width
num_2 = Number(Slider(15, range=0..100))

# ---- group: RH_IN:height
num_3 = Number(Slider(15, range=0..100))

# ----
Z_4 = UnitZ(Factor=1)
Z_5 = UnitZ(Factor=-100)

# ---- group: Observation
addition = Addition(A=height_max_01, B=height_max_02, C=height_max_03, D=height_max_04)
multiplication = Multiplication(A=terrain_unit_size, B=terrain_unit_count_tuc_01)
dom = ConstructDomain(DomainStart=0, DomainEnd=multiplication)
dom_2 = ConstructDomain(DomainStart=0, DomainEnd=addition)

# ---- group: Visualization
number_slider = Slider(1080, range=0..1080)

# ----
hs = HoopSnake(
    StartingData=Toggle(False),
    Data=return_feedback,
    Hoopsnake_Data_autoUpdate=False,
    Hoopsnake_Data_dataLimit=2147483647,
    Hoopsnake_Data_resetCounter=True,
    Hoopsnake_Data_updateView=True)  # -> simplify(Feedback), FeedbackHistory, LoopsCounter, IterationsCounter
panel = Panel(hs.IterationsCounter)
rl_agent = RLAgent(done=hs.Feedback)  # -> done, ep_count, p1, p2, p3; inputs done: list
# ---------- rl_agent: Python ----------
# -*- coding: utf-8 -*-
""" 
Python Script
Created on  Friday August 2021 07:49:42 
@author:  houssame e. hsain 

[desc]
A2C RL agent
[/desc]

ARGUMENTS:
----------
<inp> 
    state
</inp>

RETURN:
----------
<out>
    action
</out>
"""

from socket import socket, AF_INET, SOCK_STREAM

HOST = '127.0.0.1'
PORT1 = 8080
PORT2 = 8083

done_ = _done

# Receive Action
with socket(AF_INET, SOCK_STREAM) as s:
    s.connect((HOST, PORT1))
    action_byt = s.recv(5000)

action_out = action_byt.decode()

p1 = [float(item) for item in action_out.splitlines()[0].split()]
p2 = [float(item) for item in action_out.splitlines()[1].split()]
p3 = [float(item) for item in action_out.splitlines()[2].split()]
# p4 = [float(item) for item in action_out.splitlines()[3].split()]
# p5 = [float(item) for item in action_out.splitlines()[4].split()]
# p6 = [float(item) for item in action_out.splitlines()[5].split()]

# Receive Episode count
with socket(AF_INET, SOCK_STREAM) as s:
    s.connect((HOST, PORT2))
    ep_count_byt = s.recv(5000)

ep_count = int(ep_count_byt.decode())
# ---------- end rl_agent ----------
merge = Merge(Data1=rl_agent.p1, Data2=rl_agent.p2, Data3=rl_agent.p3)
panel_2 = Panel(rl_agent.done)
lng = ListLength(List=rl_agent.p1)
partition = PartitionList(List=merge, Size=lng)  # -> simplify(Chunks)
branch = TreeBranch(Tree=partition, Path=path, MaintainPaths=True)
branch_2 = TreeBranch(Tree=partition, Path=path_2, MaintainPaths=True)
branch_3 = TreeBranch(Tree=partition, Path=path_3, MaintainPaths=True)

# ---- group: RH_IN:v
num_4 = Number(branch_2)

# ---- group: RH_IN:u
num_5 = Number(branch)

# ---- group: RH_IN:theta
num_6 = Number(branch_3)
rad = Radians(Degrees=num_6)

# ----
paramptonsrf = ParameterPointOnSurface(Surface=srf_2, ParameterU=num_5, ParameterV=num_4)  # -> Point, Normal
project = ProjectPoint(Point=paramptonsrf.Point, Direction=Z_4, Geometry=srf)  # -> Point, Index
rectangle = Rectangle(Plane=project.Point, XSize=num, YSize=num_2, Radius=0)  # -> Rectangle, Length
srf_3 = Surface(rectangle.Rectangle)
area = Area(Geometry=srf_3)  # -> Area, Centroid
pt = Point(area.Centroid)
rotate = Rotate(Geometry=rectangle.Rectangle, Angle=rad, Plane=pt)  # -> Geometry, Transform

# ---- group: Last building mass / Last building ftprnt
lastdex = LastIndex(List=rotate.Geometry)
item = ListItem(List=rotate.Geometry, Index=lastdex, Wrap=True)

# ---- group: Bldg masses
boxrec = BoxRectangle(Rectangle=rotate.Geometry, Height=num_3)

# ---- group: Bldg Viz
wires = BrepWireframe(Brep=boxrec, Density=-1)
preview_3d_buildings = CustomPreview(Geometry=wires, Shader=ColourSwatch(SwatchColor=RGB(0, 0, 0)))
preview_3d_buildings_2 = CustomPreview(Geometry=boxrec, Shader=ColourSwatch(SwatchColor=RGB(177, 178, 146)))

# ---- group: Last building mass
lastdex_2 = LastIndex(List=boxrec)
item_2 = ListItem(List=boxrec, Index=lastdex_2, Wrap=True)

# ----
srf_4 = Surface(item)
extr = Extrude(Base=srf_4, Direction=Z_5)

# ---- group: Observation (continued)
debrep = DeconstructBrep(Brep=item_2)  # -> Faces, Edges, Vertices
pdecon = Deconstruct(Point=debrep.Vertices)  # -> XComponent, YComponent, ZComponent
remap = RemapNumbers(Value=pdecon.YComponent, Source=dom, Target=Domain(0, 1))  # -> Mapped, Clipped
remap_2 = RemapNumbers(Value=pdecon.ZComponent, Source=dom_2, Target=Domain(0, 1))  # -> Mapped, Clipped
remap_3 = RemapNumbers(Value=pdecon.XComponent, Source=dom, Target=Domain(0, 1))  # -> Mapped, Clipped
merge_2 = Merge(Data1=graft(remap_3.Mapped), Data2=graft(remap.Mapped), Data3=graft(remap_2.Mapped))  # -> simplify(flatten(Result))
panel_3 = Panel(merge_2)

# ----
join = BrepJoin(Breps=[item_2, extr])  # -> Breps, Closed

# ---- group: Inter Bldg Relationship
shapein = ShapeInBrep(Brep=boxrec, Shape=item_2)  # -> simplify(Relation)

# ----
split = SplitBrep(Brep=join.Breps, Cutter=srf)  # -> simplify(Result)

# ---- group: CutnFill Volumes
python = GhPythonScript(Result=split)  # -> volume, cut, fill; inputs Result: tree
# ---------- python: Python ----------
__author__ = "houssame e. hsain"
__version__ = "2021.10.12"

import ghpythonlib.components as ghcomp

try:
    from ladybug_rhino.grasshopper import all_required_inputs
except ImportError as e:
    raise ImportError('\nFailed to import ladybug_rhino:\n\t{}'.format(e))

if all_required_inputs(ghenv.Component):
    volume = 0
    if _Result.Branch(0).Count == 2:
        cut, _, _, _ = ghcomp.Pufferfish.CloseMesh(_Result.Branch(0)[1], True)
        volume1, _ = ghcomp.Volume(cut)
        volume += volume1
    if _Result.Branch(1).Count == 2:
        fill, _, _, _ = ghcomp.Pufferfish.CloseMesh(_Result.Branch(1)[0], True)
        volume2, _ = ghcomp.Volume(fill)
        volume += volume2
# ---------- end python ----------
panel_4 = Panel(python.volume)
geo = Geometry(python.cut)
geo_2 = Geometry(python.fill)

# ----
preview_3d_buildings_3 = CustomPreview(Geometry=[geo, geo_2], Shader=ColourSwatch(SwatchColor=RGB(86, 80, 75)))
python_2 = GhPythonScript(Soil_volume=python.volume, bInter_relation=shapein)  # -> reward, done; inputs bInter_relation: tree
# ---------- python_2: Python ----------
"""Provides a scripting component.
    Inputs:
        bArea_relation: Relation between generated buildings masses and the boundary space.
        bInter_relation: Relation between generated building masses.
        avg_pct_comfort: Average over thermal comfort percentage values.
        builtarea_ratio: Sum of building footprint areas over buildable area.
    Output:
        reward: calculated reward."""

__author__ = "houssame eddine"
__version__ = "2021.08.13"

try:
    from ladybug_rhino.grasshopper import all_required_inputs
except ImportError as e:
    raise ImportError('\nFailed to import ladybug_rhino:\n\t{}'.format(e))

if all_required_inputs(ghenv.Component):
    reward = 0
    reward -= Soil_volume / 1000
    done = False

    bInter_relationList = [list(i) for i in bInter_relation.Branches]

    if len(bInter_relationList[0]) > 1:
        for i in bInter_relationList[0]:
            if i == 0:
                reward -= 5
            elif i == 1:
                reward -= 5
        reward += 5
# ---------- end python_2 ----------
# Reward
panel_5 = Panel(python_2.reward)

# ---- group: RH_OUT:Reward
num_7 = Number(python_2.reward)

# ---- group: RH_OUT:Done
bool = Boolean(python_2.done)

# ---- group: RH_OUT:Observation
num_8 = Number(merge_2)

# ---- group: Visualization (continued)
captureview = LBCaptureView(
    viewport="Perspective",
    width=number_slider,
    height=number_slider,
    mode="Wireframe",
    episode=rl_agent.ep_count,
    I=hs.IterationsCounter,
    reward=num_7,
    capture=boxrec)  # -> Visualization; plug-in component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
panel_6 = Panel(captureview)

# ----
return_feedback = Gh_client(observation=num_8, reward=num_7, done=bool)  # -> done; inputs observation: list, reward: list, done: list
# ---------- return_feedback: Python ----------
# -*- coding: utf-8 -*-
""" 
Python Script

[desc]
Description of the plugin Here
Write here any thing... 
[/desc]

ARGUMENTS:
----------
<inp>
    done
</inp>
<inp> 
    reward
</inp>

RETURN:
----------
<out>
    done_out
</out>
"""
from socket import socket, AF_INET, SOCK_STREAM
import pickle

HOST = '127.0.0.1'
PORT1 = 8084
PORT2 = 8081
PORT3 = 8082

done_ = done

# Send observation
obs = pickle.dumps(observation)
# obs_str = str(observation)
# obs_byt = obs.encode()

with socket(AF_INET, SOCK_STREAM) as s:
    s.connect((HOST, PORT1))
    s.send(obs)

# Send Reward
reward_str = str(reward)
reward_byt = reward_str.encode()

with socket(AF_INET, SOCK_STREAM) as s:
    s.connect((HOST, PORT2))
    s.send(reward_byt)

# Send done
done_str = str(done)
done_byt = done_str.encode()

with socket(AF_INET, SOCK_STREAM) as s:
    s.connect((HOST, PORT3))
    s.send(done_byt)
# ---------- end return_feedback ----------

# ==== cluster TerrainGenerator
start_point = ClusterInput()
length = ClusterInput()
width = ClusterInput()
tuc_01 = ClusterInput()
tuc_02 = ClusterInput()
tuc_03 = ClusterInput()
tuc_03_2 = ClusterInput()
hmax01 = ClusterInput()
hmax02 = ClusterInput()
hmax03 = ClusterInput()
hmax04 = ClusterInput()
seed = ClusterInput()
rectangle = Rectangle(Plane=PlaneXY(0, 0, 0), XSize=length, YSize=width, Radius=0)  # -> Rectangle, Length
arrrec = RectangularArray(Geometry=start_point, Cell=rectangle.Rectangle, XCount=tuc_01, YCount=tuc_01)  # -> Geometry, Transform
lng = ListLength(List=arrrec.Geometry)
random = Random(Range=hmax01, Number=lng, Seed=seed)
Z = UnitZ(Factor=random)
move = Move(Geometry=arrrec.Geometry, Motion=Z)  # -> Geometry, Transform
srfgrid = SurfaceFromPoints(Points=move.Geometry, UCount=tuc_01, Interpolate=False)
toporandomnoise = TopoRandomNoise(C=srfgrid, N=tuc_02, R=hmax02, S=seed)
toporandomnoise_2 = TopoRandomNoise(C=toporandomnoise, N=tuc_03, R=hmax03, S=seed)
toporandomnoise_3 = TopoRandomNoise(C=toporandomnoise_2, N=tuc_03_2, R=hmax04, S=seed)
srfgrid_2 = SurfaceFromPoints(Points=arrrec.Geometry, UCount=tuc_01, Interpolate=False)
terrain_srf = ClusterOutput(toporandomnoise_3)
base_srf = ClusterOutput(srfgrid_2)

# ==== cluster TopoRandomNoise
C = ClusterInput()
N = ClusterInput()
R = ClusterInput()
S = ClusterInput()
bbox = BoundingBox(Content=C, Plane=PlaneXY(0, 0, 0))  # -> Box, Box_2
debox = DeconstructBox(Box=bbox.Box)  # -> Plane, X, Y, Z
range = Range(Domain=debox.X, Steps=N)
range_2 = Range(Domain=debox.Y, Steps=N)
pt = ConstructPoint(XCoordinate=graft(range), YCoordinate=range_2, ZCoordinate=0)
Z = UnitZ(Factor=1)
project = ProjectPoint(Point=pt, Direction=Z, Geometry=C)  # -> flatten(Point), Index
lng = ListLength(List=project.Point)
random = Random(Range=R, Number=lng, Seed=S)
Z_2 = UnitZ(Factor=random)
move = Move(Geometry=project.Point, Motion=Z_2)  # -> Geometry, Transform
srfgrid = SurfaceFromPoints(Points=move.Geometry, UCount=expr("x+1", N), Interpolate=False)
S_2 = ClusterOutput(srfgrid)
